# Dynamo graph Guide Lines V3.dyn (Dynamo 2.18.1.5096)
# packages: Clockwork for Dynamo 2.x 2.6.0

path_temp_file = CodeBlock { "C:/TEMP/test15.xml"; }
select_model_elements = DSModelElementsSelection()  # 6 picked in the model
python_script = Python(IN[0]=select_model_elements)  # IronPython2
# ---------- python_script.python (43 lines) ----------
import System
import clr
clr.AddReference('RevitAPI')
from Autodesk.Revit.DB import *

clr.AddReference("RevitNodes")
import Revit
clr.ImportExtensions(Revit.Elements)

def GetCategory(item):
	if not item: return None, None
	objtype = item.GetType().ToString()
	if objtype == "Autodesk.Revit.DB.ParameterFilterElement": return [GetCategoryObjects(x) for x in item.GetCategories()]
	elif objtype == "Autodesk.Revit.DB.ViewSchedule": return GetCategoryObjects(item.Definition.CategoryId)
	elif objtype == "Autodesk.Revit.DB.Family": return GetCategoryObjects(item.FamilyCategoryId)
	elif objtype == "Autodesk.Revit.DB.GraphicsStyle":  return GetCategoryObjects(item.GraphicsStyleCategory.Id)
	elif objtype == "Revit.Application.Document":
		if item.IsFamilyDocument: 
			clr.AddReference("RevitServices")
			import RevitServices
			from RevitServices.Persistence import DocumentManager
			return GetCategoryObjects(DocumentManager.Instance.CurrentDBDocument.OwnerFamily.FamilyCategoryId)
		else: return None, None
	elif objtype == "Autodesk.Revit.DB.Category": 
		if item.Parent: return GetCategoryObjects(item.Parent.Id)
		else: return None, None
	elif hasattr(item, "Category"): 
		if item.Category: return GetCategoryObjects(item.Category.Id)
		else: return None, None
	else: return None, None

def GetCategoryObjects(catID):
	if not catID: return None, None
	returnBic = System.Enum.ToObject(BuiltInCategory, catID.IntegerValue)
	try: returnCat =  Revit.Elements.Category.ById(catID.IntegerValue)
	except: returnCat = None
	return returnCat, returnBic


items = UnwrapElement(IN[0])

if isinstance(IN[0], list): OUT = map(list, zip(*[GetCategory(x) for x in items]))
else: OUT = GetCategory(items)
# ----------------------------------------
firstItem = List.FirstItem(list=python_script)

# group: Floors
name = Category.Name(category=firstItem)
code_block = CodeBlock { "Floors"; }
eq = name == code_block
filterByBoolMask = List.FilterByBoolMask(list=select_model_elements, mask=eq)
boolean = BoolSelector(false)
boolean_2 = BoolSelector(true)
python_script_2 = Python(IN[0]=filterByBoolMask.in, IN[1]=boolean, IN[2]=boolean_2)  # IronPython2
# ---------- python_script_2.python (90 lines) ----------
#Copyright(c) 2016, Dimitar Venkov
# @5devene, dimitar.ven@gmail.com

import clr
import math

clr.AddReference("RevitServices")
import RevitServices
from RevitServices.Persistence import DocumentManager
from RevitServices.Transactions import TransactionManager
doc = DocumentManager.Instance.CurrentDBDocument

clr.AddReference("RevitNodes")
import Revit
clr.ImportExtensions(Revit.Elements)
clr.ImportExtensions(Revit.GeometryConversion)

clr.AddReference("RevitAPI")
from Autodesk.Revit.DB import *

def tolist(obj1):
	if hasattr(obj1,"__iter__"): return obj1
	else: return [obj1]

elements = UnwrapElement(tolist(IN[0]))
getModel = IN[1]

accepted_mc = "Autodesk.Revit.DB.ModelLine, Autodesk.Revit.DB.ModelArc, Autodesk.Revit.DB.ModelEllipse, Autodesk.Revit.DB.ModelHermiteSpline, Autodesk.Revit.DB.ModelNurbSpline"

def almost_eq(line, mc):
	line2 = mc.Location.Curve
	xyz1 = line.Evaluate(0.5, True)
	if not line2.IsBound:
		xyz2 = line2.Center
		try: xyz1 = line.Center
		except: pass
	else:
		xyz2 = line2.Evaluate(0.5, True)
	if xyz1.DistanceTo(xyz2) <= 0.0001:
		return True
	else:
		return False

def clean1(l1):
	for i in xrange(len(l1) ):
		l1[i] = [x for x in l1[i] if x != None]
	return l1

def getSketch(el1):
	try:
		sk1 = doc.GetElement(ElementId(el1.Id.IntegerValue - 1) )
	except:
		sk1 = None
	if not getModel and sk1 is not None and sk1.GetType().ToString() == 'Autodesk.Revit.DB.Sketch':
		profile = sk1.Profile
	else:
		t1 = SubTransaction(doc)
		t1.Start()
		deleted = doc.Delete(el1.Id)
		t1.RollBack()
		
		profile, mc = CurveArrArray(), []
		for d in deleted:
			test_el = doc.GetElement(d)
			el_type = test_el.GetType().ToString()
			if el_type == "Autodesk.Revit.DB.Sketch":
				profile = test_el.Profile
				if not getModel:
					break
			elif getModel and el_type in accepted_mc :
				mc.append(test_el)

	ordered_mc = [ [None] * i.Size for i in profile] if getModel else []
	curves = [ [None] * i.Size for i in profile]
	for i in xrange(profile.Size):
		for j in xrange(profile[i].Size):
			curves[i][j] = profile[i][j].ToProtoType()
			if getModel:
				for k in xrange(len(mc)):
					if almost_eq(profile[i][j], mc[k]):
						ordered_mc[i][j] = mc[k].ToDSType(True)
						del mc[k]
						break
						
	return curves, clean1(ordered_mc)

TransactionManager.Instance.EnsureInTransaction(doc)
result = map(getSketch, elements)
TransactionManager.Instance.TransactionTaskDone()
OUT = [r[0] for r in result], [r[1] for r in result]
# ----------------------------------------
flatten = List.Flatten(list=python_script_2)

# group: Walls
name_2 = Category.Name(category=firstItem)
code_block_2 = CodeBlock { "Walls"; }
eq_2 = name_2 == code_block_2
filterByBoolMask_2 = List.FilterByBoolMask(list=select_model_elements, mask=eq_2)
geometry = Element.Geometry(element=filterByBoolMask_2.in)
explode = Geometry.Explode(geometry=geometry)
flatten_2 = List.Flatten(list=explode)
area = Surface.Area(surface=flatten_2)
maximumItem = List.MaximumItem(list=area)
indexOf = List.IndexOf(list=area, element=maximumItem)
getItemAtIndex = List.GetItemAtIndex(list=flatten_2, index=indexOf)
outerPerimeterCurves = AnalyticalAutomation.Geometry.Surface.OuterPerimeterCurves(surface=getItemAtIndex)

curves = PolyCurve.Curves(polyCurve=outerPerimeterCurves)

# group: Structural Framing
name_3 = Category.Name(category=firstItem)
code_block_3 = CodeBlock { "Structural Framing"; }
eq_3 = name_3 == code_block_3
filterByBoolMask_3 = List.FilterByBoolMask(list=select_model_elements, mask=eq_3)
location = StructuralFraming.Location(structuralFraming=filterByBoolMask_3.in)

# group: Structural Columns
name_4 = Category.Name(category=firstItem)
code_block_4 = CodeBlock { "Structural Columns"; }
eq_4 = name_4 == code_block_4
filterByBoolMask_4 = List.FilterByBoolMask(list=select_model_elements, mask=eq_4)
code_block_5 = CodeBlock { "Column Style"; 1; }
setParameterByName = Element.SetParameterByName(element=filterByBoolMask_4.in, parameterName=code_block_5.out0, value=code_block_5.out1)
location_2 = StructuralFraming.Location(structuralFraming=setParameterByName)

# group: Structural Foundations
name_5 = Category.Name(category=firstItem)
code_block_6 = CodeBlock { "Structural Foundations"; }
eq_5 = name_5 == code_block_6
filterByBoolMask_5 = List.FilterByBoolMask(list=select_model_elements, mask=eq_5)
getLocation = Element.GetLocation(element=filterByBoolMask_5.in)
code_block_7 = CodeBlock { 0; 0; -2000; }
byCoordinates = Vector.ByCoordinates(x=code_block_7.out0, y=code_block_7.out1, z=code_block_7.out2)
translate = Geometry.Translate(geometry=getLocation, direction=byCoordinates)
byStartPointEndPoint = Line.ByStartPointEndPoint(startPoint=getLocation, endPoint=translate)

python_script_3 = Python(IN[0]=flatten, IN[1]=curves, IN[2]=location, IN[3]=location_2, IN[4]=byStartPointEndPoint)  # CPython3
# ---------- python_script_3.python (42 lines) ----------
# Load the Python Standard and DesignScript Libraries
import sys
import clr
clr.AddReference('ProtoGeometry')
from Autodesk.DesignScript.Geometry import *

# The inputs to this node will be stored as a list in the IN variables.
dataEnteringNode = IN
lst0 = IN[0]
lst1 = IN[1]
lst2 = IN[2]
lst3 = IN[3]
lst4 = IN[4]

if isinstance(lst0, list):
    lst0 = lst0
else:
    lst0 = []
 
if isinstance(lst1, list):
    lst1 = lst1
else:
    lst1 = []

if isinstance(lst2, list):
    lst2 = lst2
else:
    lst2 = []

if isinstance(lst3, list):
    lst3 = lst0
else:
    lst3 = []
    
if isinstance(lst4, list):
    lst4 = lst4
else:
    lst4 = []
    
lst5 = lst0 + lst1 + lst2 + lst3 + lst4 
    
OUT = lst5
# ----------------------------------------
flatten_3 = List.Flatten(list=python_script_3)
startPoint = Curve.StartPoint(curve=flatten_3)
X = Point.X(point=startPoint)
Y = Point.Y(point=startPoint)
Z = Point.Z(point=startPoint)
endPoint = Curve.EndPoint(curve=flatten_3)
X_2 = Point.X(point=endPoint)
Y_2 = Point.Y(point=endPoint)
Z_2 = Point.Z(point=endPoint)
code_block_8 = CodeBlock { "Levels"; }
byName = Category.ByName(name=code_block_8)
all_elements_of_category = ElementsOfCategory(Category=byName)
code_block_9 = CodeBlock { "Elevation"; }
getParameterValueByName = Element.GetParameterValueByName(element=all_elements_of_category, parameterName=code_block_9)
round = Math.Round(number=getParameterValueByName)
grids = CodeBlock { "<X>0 3000 3000</X>"; "<Y>0 5000 5000</Y>"; }
python_script_4 = Python(IN[0]=X, IN[1]=Y, IN[2]=Z, IN[3]=X_2, IN[4]=Y_2, IN[5]=Z_2, IN[6]=round, IN[7]=grids.out0, IN[8]=grids.out1)  # CPython3
# ---------- python_script_4.python (149 lines) ----------
prefix1 = '<Frame>' \
          '<ProjectName/>' \
          '<ProjectNumber/>' \
          '<ConsequenceClass>CC2</ConsequenceClass>' \
          '<DesignWorkingLife>50</DesignWorkingLife>' \
          '<ExportDateTime>2024-05-24 11:57:30Z</ExportDateTime>' \
          '<XMLExportVersion>v4.0.30319</XMLExportVersion>' \
          '<Nodes/>' \
          '<Supports/>' \
          '<Grids>' \

prefix2 = '<X_Lable>' \
          'A B C D E F G H I J K L M N O P Q R S T U V W X Y Z' \
          '</X_Lable>' \
       
prefix3 = '<Y_Lable>' \
          '1 2 3 4 5 6 7 8 9 10 11 12 13 14 15 16 17 18 19 20 21 22 23 24 25' \
          '</Y_Lable>' \

prefix4 = '</Grids>' \
          '<Profiles/>' \
          '<Lines>'\

X1 = IN[0]
Y1 = IN[1]
Z1 = IN[2]
X2 = IN[3]
Y2 = IN[4]
Z2 = IN[5]
XVal = IN[7]
YVal = IN[8]

# ELEVATIONS
elevationlist = IN[6]

elevationlist.sort()

lstnew = []
n = 0
min = round(elevationlist[0])
lstnew.append(min)
str_new = str(min)

for i in elevationlist:
    if len(elevationlist) == n + 1:
        break
    dif = elevationlist[n + 1] - elevationlist[n]
    n = n + 1
    lstnew.append(dif)
    str_new = str_new + " " + str(round(dif))

str1 = "<Z>" + str_new + "</Z>"
str2 = "<Z_Lable>" + str_new + "</Z_Lable>"

prefix = prefix1 + XVal + prefix2 + YVal + prefix3 + str1 + str2 + prefix4

lst = []
for x1, y1, z1, x2, y2, z2 in zip(X1, Y1, Z1, X2, Y2, Z2):
    lst.append("<FromX>" + str(round(x1)) + "</FromX>")
    lst.append("<FromY>" + str(round(y1)) + "</FromY>")
    lst.append("<FromZ>" + str(round(z1)) + "</FromZ>")
    lst.append("<ToX>" + str(round(x2)) + "</ToX>")
    lst.append("<ToY>" + str(round(y2)) + "</ToY>")
    lst.append("<ToZ>" + str(round(z2)) + "</ToZ>")

suffix = '</Lines>' \
         '<LoadCases>' \
         '<Number>1</Number>' \
         '<Description>Dead load</Description>' \
         '<Type>0</Type>' \
         '<psi0>1</psi0>' \
         '<psi1>1</psi1>' \
         '<psi2>1</psi2>' \
         '<Number>2</Number>' \
         '<Description>Live load</Description>' \
         '<Type>5</Type>' \
         '<psi0>1</psi0>' \
         '<psi1>0,9</psi1>' \
         '<psi2>0,8</psi2>' \
         '</LoadCases>' \
         '<Combinations>' \
         '<LoadCombinationNumber>1</LoadCombinationNumber>' \
         '<Description>Dead load</Description>' \
         '<CombTyp>0</CombTyp>' \
         '<Case>1</Case>' \
         '<Psi>1</Psi>' \
         '<Gamma>1,35</Gamma>' \
         '<Case>2</Case>' \
         '<Psi>1</Psi>' \
         '<Gamma>1,5</Gamma>' \
         '<LoadCombinationNumber>2</LoadCombinationNumber>' \
         '<Description>Live load</Description>' \
         '<CombTyp>0</CombTyp>' \
         '<Case>1</Case>' \
         '<Psi>1</Psi>' \
         '<Gamma>1,2</Gamma>' \
         '<Case>2</Case>' \
         '<Psi>1</Psi>' \
         '<Gamma>1,5</Gamma>' \
         '<LoadCombinationNumber>3</LoadCombinationNumber>' \
         '<Description>Dead load</Description>' \
         '<CombTyp>3</CombTyp>' \
         '<Case>1</Case>' \
         '<Psi>1</Psi>' \
         '<Gamma>1</Gamma>' \
         '<Case>2</Case>' \
         '<Psi>1</Psi>' \
         '<Gamma>1</Gamma>' \
         '<LoadCombinationNumber>4</LoadCombinationNumber>' \
         '<Description>Live load</Description>' \
         '<CombTyp>3</CombTyp>' \
         '<Case>1</Case>' \
         '<Psi>1</Psi>' \
         '<Gamma>1</Gamma>' \
         '<Case>2</Case>' \
         '<Psi>1</Psi>' \
         '<Gamma>1</Gamma>' \
         '<LoadCombinationNumber>5</LoadCombinationNumber>' \
         '<Description>SLS Permanent</Description>' \
         '<CombTyp>4</CombTyp>' \
         '<Case>1</Case>' \
         '<Psi>1</Psi>' \
         '<Gamma>1</Gamma>' \
         '<LoadCombinationNumber>6</LoadCombinationNumber>' \
         '<Description>SLS Quasi-permanent</Description>' \
         '<CombTyp>2</CombTyp>' \
         '<Case>1</Case>' \
         '<Psi>1</Psi>' \
         '<Gamma>1</Gamma>' \
         '<Case>2</Case>' \
         '<Psi>0,8</Psi>' \
         '<Gamma>1</Gamma>' \
         '</Combinations>' \
         '<RebarLongitudinal/>' \
         '<RebarStirrup/>' \
         '<Layers>' \
         '<Layer_number>1</Layer_number>' \
         '<Layer_description>Layer 1</Layer_description>' \
         '<Layer_number>2</Layer_number>' \
         '<Layer_description>Layer 2</Layer_description>' \
         '<Layer_number>3</Layer_number>' \
         '</Layers>' \
         '</Frame>' \

Guidelines = ''.join(str(SL) for SL in lst)

xml_str = prefix + Guidelines + suffix

OUT = xml_str
# ----------------------------------------
writeText = FileSystem.WriteText(filePath=path_temp_file, text=python_script_4)
code_block_10 = CodeBlock(passthrough=path_temp_file, waitfor=writeText) { [passthrough,waitfor][0]; }
open_xfem4u = BoolSelector(false)
python_script_5 = Python(IN[0]=code_block_10, IN[1]=open_xfem4u)  # CPython3
# ---------- python_script_5.python (68 lines) ----------
import subprocess
import os
import time

def writeDirectCommandsfile(xmlfilepath: str):
    # Write Ini-file for directcommands
    pathdirectcommands = os.path.join(
        os.getenv('LOCALAPPDATA'), 'Struct4u', 'DirectCommands_XFEM4U.ini')
    row1 = '[Struct4u]\n'
    row2 = 'Import_XML=' + xmlfilepath + '\n'
    content = row1 + row2

    file = open(pathdirectcommands, "w")
    a = file.write(content)
    file.close()


def openXMLInXFEM4U(fileName):
    # Open XML file in XFEM4U
    os.system("C:/Struct4u/XFEM4U/wframe3d.exe " + fileName)

def openXFEM4U():
    # Run XFEM4U
    path = r"C:/Struct4u/XFEM4U/wframe3d.exe"
    os.spawnl(os.P_NOWAIT,  # flag
              path,  # program
              path)  # arguments
    # import subprocess
    # try:
    #    subprocess.run("C:/Struct4u/XFEM4U/wframe3d.exe", shell=True, check=False)
    # except:
    #    print("exception")


def process_exists(process_name):
    call = 'TASKLIST', '/FI', 'imagename eq %s' % process_name
    # use buildin check_output right away
    output = subprocess.check_output(call).decode()
    # check in last line for process name
    last_line = output.strip().split('\r\n')[-1]
    # because Fail message could be translated
    return last_line.lower().startswith(process_name.lower())


def OpenXMLXFEM4U(pathxml):
    # CHECK IF XFEM4U IS OPENED. IF NOT OPEN XFEM4U
    if process_exists("wframe3d.exe") is True:
        pass
    else:
        openXFEM4U()
        time.sleep(20)
    # WRITE DIRECTCOMMANDS TO XFEM4U, THEN XML-FILE IS OPENED IN XFEM4U
    writeDirectCommandsfile(pathxml)
    
    

# Place your code below this line

path = IN[0]
bool = IN[1]

if bool:
    OpenXMLXFEM4U(path)
else: 
    pass

# Assign your output to the OUT variable.
OUT = path
# ----------------------------------------
python_script_6 = Python(IN[0]=round)  # CPython3
# ---------- python_script_6.python (21 lines) ----------
elevationlist = IN[0]

elevationlist.sort()

lstnew = []
n = 0
min = round(elevationlist[0])
lstnew.append(min)
str_new = str(min)

for i in elevationlist:
    if len(elevationlist) == n+1:
        break
    dif = elevationlist[n+1]-elevationlist[n]
    n = n + 1
    lstnew.append(dif)
    str_new = str_new + " " + str(round(dif))
    
#'<Z>0 12000</Z>' \
#'<Z_Lable>+0</Z_Lable>' \
OUT = elevationlist, lstnew, str_new
# ----------------------------------------
code_block_11 = CodeBlock(a=python_script_6) { a[2]; }
sendTo = Custom[Clipboard.SendTo](str=code_block_11)  # package Clockwork for Dynamo 2.x; Copies a string to the clipboard.
