# Dynamo custom node BuildingPy_Frame_by_startpoint_endpoint_profile.dyf (Dynamo 2.18.1.5096)
# category: BuildingPy

BPy_PythonString = Input(BPy_PythonString: var[]..[])
string = StringInput("""
def DesignScriptPointToBPPoint(DesignScriptPoint):
    import clr
    clr.AddReference('ProtoGeometry')
    from Autodesk.DesignScript.Geometry import Point as pnt
    BPPoint = Point(DesignScriptPoint.X,DesignScriptPoint.Y,DesignScriptPoint.Z)
    return BPPoint""")
string_2 = StringInput("""
import clr
clr.AddReference('ProtoGeometry')

from Autodesk.DesignScript.Geometry import Point as pnt

p1 = IN[0]
p2 = IN[1]
prof = IN[2]

p1n = DesignScriptPointToBPPoint(p1)
p2n = DesignScriptPointToBPPoint(p2)

fram = Frame.by_startpoint_endpoint_profile(p1n,p2n,prof,prof,BaseSteel)
OUT = fram""")
concat = String.Concat(string0=BPy_PythonString, string1=string, string2=string_2)
StartPoint = Input(StartPoint: var[]..[])
EndPoint = Input(EndPoint: var[]..[])
ProfileName = Input(ProfileName: var[]..[])
python_script_from_string = PythonStringNode(script=concat, IN[0]=StartPoint, IN[1]=EndPoint, IN[2]=ProfileName)  # CPython3
BPy_Frame = Output(python_script_from_string)
