# Dynamo graph BuildingPy Dynamo.dyn (Dynamo 2.18.1.5096)

file_path = Filename("C:\Users\mikev\Documents\GitHub\Struct4U\Version 2\BuildingPy.py")
readText = FileSystem.ReadText(file=file_path)
string = StringInput("""
import clr
clr.AddReference('ProtoGeometry')

from Autodesk.DesignScript.Geometry import Point as pnt

p1 = Point(0,0,0)

fram = Frame.by_startpoint_endpoint_rect(Point(0,0,0),Point(0,14400,0),350,500,"350x500",0,BaseConcrete)
OUT = p1, fram.curve3d""")
concat = String.Concat(string0=readText, string1=string)
python_script_from_string = PythonStringNode(script=concat)  # CPython3; unwired: IN[0]
byPointsFaceIndices = Mesh.ByPointsFaceIndices()  # unwired: vertexPositions, indices
python_script = Python()  # CPython3
# ---------- python_script.python (17 lines) ----------
# Load the Python Standard and DesignScript Libraries
import sys
import clr
clr.AddReference('ProtoGeometry')
from Autodesk.DesignScript.Geometry import *

# The inputs to this node will be stored as a list in the IN variables.
dataEnteringNode = IN

p1 = Point.ByCoordinates(0,0,0)
p2 = Point.ByCoordinates(3000,0,0)

l1 = Line.ByStartPointEndPoint(p1,p2)
# Place your code below this line

# Assign your output to the OUT variable.
OUT = p1, l1
# ----------------------------------------
file_path_2 = Filename("C:\Users\mikev\Documents\GitHub\Struct4U\Version 2\BuildingPy.py")
readText_2 = FileSystem.ReadText(file=file_path_2)

# group: Frame.by_startpoint_endpoint_profile
string_2 = StringInput("""
def DesignScriptPointToBPPoint(DesignScriptPoint):
    import clr
    clr.AddReference('ProtoGeometry')
    from Autodesk.DesignScript.Geometry import Point as pnt
    BPPoint = Point(DesignScriptPoint.X,DesignScriptPoint.Y,DesignScriptPoint.Z)
    return BPPoint""")
string_3 = StringInput("""
import clr
clr.AddReference('ProtoGeometry')

from Autodesk.DesignScript.Geometry import Point as pnt

p1 = IN[0]
p2 = IN[1]
prof = IN[2]

p1n = DesignScriptPointToBPPoint(p1)
p2n = DesignScriptPointToBPPoint(p2)

fram = Frame.by_startpoint_endpoint_profile(p1n,p2n,prof,prof,BaseSteel)
OUT = fram, fram.""")
concat_2 = String.Concat(string0=readText_2, string1=string_2, string2=string_3)
byCoordinates = Point.ByCoordinates()
code_block = CodeBlock { 1000; 1000; 1000; }
byCoordinates_2 = Point.ByCoordinates(x=code_block.out0, y=code_block.out1, z=code_block.out2)
code_block_2 = CodeBlock { "HEA400"; }
python_script_from_string_2 = PythonStringNode(script=concat_2, IN[0]=byCoordinates, IN[1]=byCoordinates_2, IN[2]=code_block_2)  # CPython3

code_block_3 = CodeBlock(a=python_script_from_string_2) { a[0]; a[1]; }

# group: Project
string_4 = StringInput("""
projectnumber = IN[0]
projectname = IN[1]
project = BuildingPy(projectname, projectnumber)

objects = IN[2]

for i in objects:
	project.objects.append(i)

OUT = project""")
concat_3 = String.Concat(string0=readText_2, string1=string_4)
code_block_4 = CodeBlock { "0"; "Projectnaam"; }
list_create = List.Create(item0=code_block_3.out0)  # frozen
python_script_from_string_3 = PythonStringNode(script=concat_3, IN[0]=code_block_4.out0, IN[1]=code_block_4.out1, IN[2]=list_create)  # CPython3

# group: OpenXFEM4U
string_5 = StringInput("""
project = IN[0]
pathxml = IN[1]

gridinput =  ["0 1000 1000",seqChar,"0 4x3600",seqNumber,"0"]

createXFEM4UXML(project,pathxml,gridinput)

OpenXMLXFEM4U(pathxml)""")
concat_4 = String.Concat(string0=readText_2, string1=string_5)
code_block_5 = CodeBlock { "C:/TEMP/test.xml"; }
python_script_from_string_4 = PythonStringNode(script=concat_4, IN[0]=python_script_from_string_3, IN[1]=code_block_5)  # CPython3; frozen

bySweep = Surface.BySweep()  # unwired: profile, path
